# Dynamo graph AI constructor test - load.dyn (Dynamo 1.3.0.875)

# group: Folder
file_path = Filename(".\AI constructor test.json")

string = StringInput("AI IO test - Simple Linear Regression.json")

# group: IO
directoryName = FilePath.DirectoryName(file_path)
combine = FilePath.Combine(directoryName, string)

# group: Deserialise
loadModel = AI.Machine.LoadModel(combine)

# group: Inspect
name = AI.Machine.Name(loadModel)
description = AI.Machine.Description(loadModel)
GUID = AI.Machine.GUID(loadModel)
getAlgorithm = AI.Machine.GetAlgorithm(loadModel)
isTrained = AI.Machine.IsTrained(loadModel)
resultDataType = AI.Machine.ResultDataType(loadModel)
