# Dynamo graph AI constructor test - save.dyn (Dynamo 1.3.0.875)

simpleLinearRegression = AI.MachineLearning.Regression.SimpleLinearRegression()
multivariateLinearRegression = AI.MachineLearning.Regression.MultivariateLinearRegression()
code_block = CodeBlock { "TestMachine #1"; "simple machine"; }
regressionMachine = AI.Machine.RegressionMachine.RegressionMachine(multivariateLinearRegression, code_block.out0, code_block.out1)
file_path = Filename(".\AI constructor test.json")
saveModel = AI.Machine.RegressionMachine.SaveModel(regressionMachine, file_path)
name = AI.Machine.Machine.Name(regressionMachine)
GUID = AI.Machine.Machine.GUID(regressionMachine)
watch = Watch(GUID)
algorithm = AI.Machine.Machine.Algorithm(regressionMachine)
watch_2 = Watch(algorithm)
multipleLinearRegression = AI.MachineLearning.Regression.MultipleLinearRegression()
